# Grasshopper definition Grasshopper.gh (Grasshopper 1.0.7)
# plug-ins: gHowl

udp = UDPReceiver(Port=Slider(9001, range=0..10000), Pattern=0)  # -> Info, Data
panel = Panel(udp.Data)
split = TextSplit(Text=udp.Data, Separators=",")
number_slider = Slider(18, range=0..100)
sqgrid = Square(
    Plane=PlaneXY(0, 0, 0),
    Size=Slider(40, range=0..100),
    ExtentX=Slider(17, range=0..100),
    ExtentY=Slider(14, range=0..100))  # -> Cells, Points
avr = Average(Input=flatten(sqgrid.Points))  # disabled
num = Number(split)
pt = Point(sqgrid.Points)
number_slider_2 = Slider(1, range=0..1)  # disabled
dist = Distance(PointA=pt, PointB=avr)  # disabled
dom = ConstructDomain(DomainStart=expr("-x", number_slider), DomainEnd=number_slider)

# ---- group: GH Counter
toggle = BooleanToggle(True)  # disabled
button = Button()  # disabled
start = Slider(0, range=0..100)  # disabled
increment = Slider(1, range=-2..3)  # disabled
trigger = Trigger(Interval=1000, TimerInterval=1000, Target=counter)  # disabled
counter = ImprovedDataRec(x=start, enable=toggle, reset=button, increment=increment)  # -> x; inputs x: Int32, enable: Boolean, reset: Boolean, increment: Int32; disabled
# ---------- counter: Python ----------
from Grasshopper import DataTree
if reset or 'rec' not in globals(): rec = x
if enable: rec = rec + increment  
x = rec
print x
# ---------- end counter ----------

# ----
rectangle = Rectangle(Plane=sqgrid.Points, XSize=dom, YSize=dom, Radius=0)  # -> graft(Rectangle), Length
bnd = Bounds(Numbers=flatten(dist))  # disabled
multiplication = Multiplication(A=num, B=Slider(60, range=0..100))
dom_2 = ConstructDomain(DomainStart=0, DomainEnd=number_slider_2)  # disabled
Z = UnitZ(Factor=1)
panel_2 = Panel(rectangle.Rectangle)
remap = RemapNumbers(Value=dist, Source=bnd, Target=dom_2)  # -> Mapped, Clipped; disabled
amp = Amplitude(Vector=Z, Amplitude=multiplication)  # -> graft(Vector)
panel_3 = Panel(counter)  # disabled
number_slider_3 = Slider(8, range=0..10)  # disabled
number_slider_4 = Slider(2, range=0..10)  # disabled
viewer = ParamViewer(rectangle.Rectangle)
avr_2 = Average(Input=num)
panel_4 = Panel(amp)
extr = Extrude(Base=rectangle.Rectangle, Direction=amp)
expression = Expression(k=number_slider_3, r=remap.Mapped, speed=number_slider_4, t=panel_3, Expression="max(0, sin(2*pi*(k*r - speed*t)))")  # disabled
cap = CapHoles(Brep=extr)
multiplication_2 = Multiplication(A=expression, B=avr_2)  # disabled
Z_2 = UnitZ(Factor=1)  # disabled
amp_2 = Amplitude(Vector=Z_2, Amplitude=multiplication_2)  # disabled
panel_5 = Panel(amp_2)  # disabled
