# Grasshopper definition grasshopper_python.gh (Grasshopper 1.0.7)
# plug-ins: MeshEdit Components

number_slider = Slider(90, range=0..100)
number_slider_2 = Slider(120, range=0..200)
sqgrid = Square(
    Plane=PlaneXY(0, 0, 0),
    Size=Slider(20, range=0..100),
    ExtentX=expr("x-1", number_slider_2),
    ExtentY=expr("x-1", number_slider))  # -> Cells, flatten(Points)
mesh_frompoints = MeshFromPoints(Points=sqgrid.Points, UDirection=number_slider_2, VDirection=number_slider)
ghpython = GhPythonScript(base_mesh=mesh_frompoints, run=Toggle(True))  # -> out, a; inputs base_mesh: Mesh, run: Boolean
# ---------- ghpython: Python ----------
import Rhino.Geometry as rg
import socket
from scriptcontext import sticky
import Grasshopper as gh # Added this import

# 1. Config
reset = False
target_port = 9001
sock_key = "audio_sock_" + str(target_port)
mesh_cache_key = "cached_mesh_" + str(target_port)

def get_live_socket(p):
    if sock_key in sticky: return sticky[sock_key]
    try:
        s = socket.socket(socket.AF_INET, socket.SOCK_DGRAM)
        s.setsockopt(socket.SOL_SOCKET, socket.SO_REUSEADDR, 1)
        s.bind(("127.0.0.1", int(p)))
        s.setblocking(False)
        sticky[sock_key] = s
        return s
    except: return None

# --- THE NEW CLEAN CALLBACK ---
def callback(doc):
    ghenv.Component.ExpireSolution(False)

if run:
    if mesh_cache_key not in sticky or reset:
        if base_mesh:
            sticky[mesh_cache_key] = base_mesh.DuplicateMesh()
            print('Mesh Cache Successfully')
    work_mesh = sticky.get(mesh_cache_key)
    sock = get_live_socket(target_port)
    
    a = base_mesh
    if sock:
        try:
            data = None
            while True:
                try:
                    data, addr = sock.recvfrom(65536)
                    if raw: data = raw
                except:
                    break
            
            if data: 
                raw_str = data.decode("utf-8")
                z_values = [float(val) for val in raw_str.split(',') if val.strip()]
                
                # Update Vertices in-place
                verts = base_mesh.Vertices
                count = min(len(verts), len(z_values))
                for i in range(count):
                    v = verts[i]
                    verts.SetVertex(i, v.X, v.Y, z_values[i])
                
                # a = base_mesh
                
                # --- THE FIX: Standard GH Schedule ---
                # This tells the document: "Once you are done, run this callback"
            ghenv.Component.OnPingDocument().ScheduleSolution(20, gh.Kernel.GH_Document.GH_ScheduleDelegate(callback))
            
        except socket.error:
            # If no data, keep the listener heartbeat going
            ghenv.Component.OnPingDocument().ScheduleSolution(1, gh.Kernel.GH_Document.GH_ScheduleDelegate(callback))
        except Exception as e:
            print("Data Error: " + str(e))
            ghenv.Component.OnPingDocument().ScheduleSolution(50, gh.Kernel.GH_Document.GH_ScheduleDelegate(callback))
else:
    if sock_key in sticky:
        try:
            sticky[sock_key].close()
            del sticky[sock_key]
            print("Socket Released")
        except: pass
# ---------- end ghpython ----------
panel = Panel(ghpython.a)
final = Data(ghpython.a)
