# Grasshopper definition grasshopper_revised.gh (Grasshopper 1.0.7)
# plug-ins: gHowl, MeshEdit Components

udp = UDPReceiver(Port=Slider(9001, range=0..10000), Pattern=0)  # -> Info, Data
split = TextSplit(Text=udp.Data, Separators=",")
panel = Panel(udp.Data)
num = Number(split)
sqgrid = Square(
    Plane=PlaneXY(0, 0, 0),
    Size=Slider(30, range=0..100),
    ExtentX=Slider(119, range=0..200),
    ExtentY=Slider(59, range=0..100))  # -> Cells, flatten(Points)
multiplication = Multiplication(A=num, B=Slider(60, range=0..100))
Z = UnitZ(Factor=1)
avr = Average(Input=num)
pt = Point(sqgrid.Points)
amp = Amplitude(Vector=Z, Amplitude=multiplication)
Z_2 = UnitZ(Factor=amp)
panel_2 = Panel(amp)
move = Move(Geometry=pt, Motion=Z_2)  # -> Geometry, Transform
pt_2 = Point(move.Geometry)
frompoints = MeshFromPoints(Points=pt_2, UDirection=Slider(120, range=0..200), VDirection=Slider(60, range=0..100))
